# Grasshopper definition danzer.ghx (Grasshopper 0.9.14)
# plug-ins: Decodes Python Interpreter

xy = XYPlane(Origin=Point(0, 0, 0))
pt = Point(<point referenced from the Rhino model>)
decodes = DecodesPythonScript(mr=Slider(3, range=0..10), attractor=pt, threshold=Slider(0.3, range=0..1))  # -> console, a
# ---------- decodes: Python ----------
import decodes.extensions.danzerTile as dt

maxRecursion = int(mr)
if maxRecursion > 5: maxRecursion = 5
meshes = [ ]
att = attractor
thresh = threshold

def main():
    mesh = recurse([dt.DzTileK()])
    mesh_inside = [ ]
    for mesh in meshes:
        if mesh.centroid.distance(att) < thresh:
            mesh_inside.append(mesh)
    a.put(mesh_inside)

def recurse(tiles,rlvl=0):
  
  if rlvl < maxRecursion : 
    for tile in tiles: recurse(tile.inflate(),rlvl+1)
  else : 
    for tile in tiles:
      meshes.append(tile.draw())
    return

if __name__=="__main__": main()
# ---------- end decodes ----------
