# Grasshopper definition colorbar.gh (Grasshopper 0.9.14)
# plug-ins: Decodes Python Interpreter

panel = Panel("C:\Users\dustin\USA_CA_San.Francisco.Intl.AP.724940_TMY3.epw")
file = ReadFile(Path=panel, Lines=Toggle(False))
decodes = DecodesPythonScript(epw_file=file)  # -> out, DirNormIrad, DifHorzIrad, OpqSkyCvr, DryBulbTemp, DewPtTemp, RelHumid, Pressure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
# ---------- decodes: Python ----------
import decodes.extensions.parseEPW as epw_parser

def parse_epw_string(epw_string):
    """ parses an EPW file and returns structured data
    path (string) filepath to the EPW file
    desired_keys ([string]) keys indicating the values to be returned.  only keys listed in epw_keycols may be used.  
    out: an array of dicts is returned.
    """
    skip = epw_parser.number_of_epw_header_lines
    lineno = 0 # keeps track of how many lines have been parsed
    hours = [] #initalize an empty list where we'll store our dicts
    lines = epw_string.split("\n") # splits the passed string into individual strings at each newline character
    for line in lines:
        #print "this is line: " + line    
        if lineno >= skip and "," in line : # only parse this line if past the header
          hourdict = epw_parser._parse_epw_line(line, epw_parser.epw_keycols.keys()) # parse line
          if hourdict is not None : 
            hours.append(hourdict)
        lineno += 1 # keep track of how many lines have been parsed        
    return hours

hours = parse_epw_string(epw_file)

DirNormIrad = []
DifHorzIrad = []
OpqSkyCvr = []
DryBulbTemp = []
DewPtTemp = []
RelHumid = []
Pressure = []
WindDir = []
WindSpd = []
PreciptWater = []
AeroDepth = []
SnowDepth = []
YearOfSample = []

for hour in hours : 
    DirNormIrad.append(hour["DirNormIrad"])
    DifHorzIrad.append(hour["DifHorzIrad"])
    OpqSkyCvr.append(hour["OpqSkyCvr"])
    DryBulbTemp.append(hour["DryBulbTemp"])
    DewPtTemp.append(hour["DewPtTemp"])
    RelHumid.append(hour["RelHumid"])
    Pressure.append(hour["Pressure"])
    WindDir.append(hour["WindDir"])
    WindSpd.append(hour["WindSpd"])
    PreciptWater.append(hour["PreciptWater"])
    AeroDepth.append(hour["AeroDepth"])
    SnowDepth.append(hour["SnowDepth"])
    YearOfSample.append(hour["YearOfSample"])
# ---------- end decodes ----------
panel_2 = Panel(decodes.out)
panel_3 = Panel(decodes.DryBulbTemp)
panel_4 = Panel(decodes.RelHumid)
panel_5 = Panel(decodes.DifHorzIrad)
panel_6 = Panel(decodes.OpqSkyCvr)
panel_7 = Panel(decodes.DirNormIrad)
panel_8 = Panel(decodes.DewPtTemp)
