# Grasshopper definition mesh.gh (Grasshopper 0.9.14)
# plug-ins: Decodes Python Interpreter

tower = Tower(R=Slider(0.4, range=0..10), L=Slider(7.66, range=0..10))
pt = Point(Point(2.69506178, 2.913253011, 4.48168288))
dom = Domain(DomainStart=Slider(0.01, range=0.01..1), DomainEnd=Slider(1, range=0.01..1))
decodes = DecodesPythonScript(plines=tower, att_pt=pt, height_inv=dom)  # -> console, a, b; inputs plines: list
# ---------- decodes: Python ----------
dists = [att_pt.distance(pline.centroid) for pline in plines]
dist_interval = Interval(min(dists),max(dists))

for n, pline in enumerate(plines):
    verts = pline.verts
    cent = Point.centroid(verts)
    vec = Vec(verts[0],verts[1]).cross(Vec(verts[0],verts[3]))
    vec.length = Interval.remap(dists[n], dist_interval, height_inv)
    verts.insert(0,cent + vec)
    faces = [[0,1,2],[0,2,3],[0,3,4],[0,4,1]]
    a.put(Mesh(verts,faces))
# ---------- end decodes ----------

# ==== cluster Tower
R = ClusterInput()
L = ClusterInput()
cyl = Cylinder(Base=PlaneXY(0, 0, 0), Radius=R, Length=L)
divide = DivideDomain²(Domain=cyl, UCount=10, VCount=10)
subsrf = Isotrim(Surface=cyl, Domain=divide)
explode = BrepComponents(Brep=subsrf)  # -> Faces, Edges, Vertices
pline = PolyLine(Vertices=explode.Vertices, Closed=False)  # -> flatten(Polyline)
pl = ClusterOutput(pline)
