# Grasshopper definition lsystem.ghx (Grasshopper 0.9.14)
# plug-ins: Decodes Python Interpreter

decodes = DecodesPythonScript()  # -> console, a
# ---------- decodes: Python ----------
# generate the fractal drawing string
def L_system(level, initial_state, trgt, rplcmnt, trgt2, rplcmnt2):
    state = initial_state
   
    for counter in range(level):
        state2 = ''
        for character in state:
            if character == trgt:
                state2 += rplcmnt
            elif character == trgt2:
                state2 += rplcmnt2
            else:
                state2 += character
        state = state2
    return state

lstrings = L_system(4, 'FX', 'X', 'X+YF+', 'Y', '-FX-Y')

print lstrings
# ---------- end decodes ----------
