# Grasshopper definition decompose_line.ghx (Grasshopper 0.9.14)
# plug-ins: Decodes Python Interpreter

series = Series(Start=0, Step=Slider(1.3, range=0..10), Count=10)
sin = Sine(Value=series)
pt = PointXYZ(XComponent=series, YComponent=sin, ZComponent=0, System=PlaneXY(0, 0, 0))
decodes = DecodesPythonScript(points=pt, threshold=Slider(0.15, range=0..1))  # -> console, a, b; inputs points: list
# ---------- decodes: Python ----------
curve = Curve.bezier(points)

pts = []
start = curve.near_pt(points[0]).origin
vec = Vec(threshold,0,0)
step = Point(vec + start)
for i in range(5):
    new_pt = curve.near_pt(step).origin
 

b.put(new_pt)
a.put(curve)
# ---------- end decodes ----------
