# Grasshopper definition surface_optimization.ghx (Grasshopper 0.9.14)
# plug-ins: Decodes Python Interpreter

md_slider = MDSlider(
    slider_value=Point(1, 0.5353657792, 0.5),
    x_domain=Domain(0, 1),
    y_domain=Domain(0, 1),
    z_domain=Domain(0, 1),
    SliderMode=0)  # disabled
slider = Slider(1, range=0..1)  # disabled
slider_2 = Slider(1, range=0..1)  # disabled
decodes = DecodesPythonScript()  # -> console, a
# ---------- decodes: Python ----------
import math


def rot_surface(rad_cap, rad_mid, mid_height):
    pts = [Point(rad_cap+rad_cap,rad_mid,mid_height),Point(rad_mid+rad_cap,rad_mid,mid_height+mid_height),Point(rad_cap+rad_cap,rad_mid,mid_height+1)]
    def func(u,v):        
        angle = Interval.twopi().eval(u)
        xf = Xform.rotation(axis=Vec(rad_cap,rad_mid,mid_height+1)- Vec(rad_cap,rad_mid,mid_height),angle=angle)
        rot_pts = [pt*xf for pt in pts]
        
        crv = Curve.bezier(rot_pts)
        
        return crv.eval(v)
        
    return func

a.put(rot_surface)
# ---------- end decodes ----------
decodes_2 = DecodesPythonScript()  # -> console, a
# ---------- decodes_2: Python ----------
import math


def rot_surface(rad_cap, rad_mid, mid_height):
    pts = [Point(rad_cap,0,0),Point(rad_mid,0,mid_height),Point(rad_cap,0,1)]
    def func(u,v):        
        angle = Interval.twopi().eval(u)
        xf = Xform.rotation(axis=Vec(0,0,1),angle=angle)
        rot_pts = [pt*xf for pt in pts]
        
        crv = Curve.bezier(rot_pts)
        
        return crv.eval(v)
        
    return func

a.put(rot_surface)
# ---------- end decodes_2 ----------
decodes_3 = DecodesPythonScript()  # -> console, a
# ---------- decodes_3: Python ----------
def make_msh(surf):
    msh = Mesh()
    u_vals = Interval().divide(include_last=True)
    for ui in Interval().divide(include_last=True):
        for vi in u_vals:
            msh.append(surf(ui,vi).origin)
    res_u = len(u_vals)
    # simple triangulation style
    for v in range(len(u_vals)):
        row = v*res_u
        for u in range(len(u_vals)-1):
            pi_0 = row+u
            pi_1 = row+u+1
            pi_2 = row+u+res_u+1
            pi_3 = row+u+res_u
            msh.add_face(pi_0,pi_1,pi_2,pi_3)
    return msh

a.put(make_msh)
# ---------- end decodes_3 ----------
decodes_4 = DecodesPythonScript()  # -> console, a
# ---------- decodes_4: Python ----------
import math

def area_to_volume_ratio(func, res = 10):
    interval = Interval().divide(res, include_last = True)
    volumes = []
    srf_area = []
    seg = Segment(func(1,0).origin, func(1,1).origin)
    for i, v in enumerate(interval):
        pt = (func(1,v).origin)
        cpt = Point(0,0,pt.z)
        radius = cpt.distance(pt)
        if i == 0 or i == len(interval)-1:
            srf_area.append(math.pi*radius**2)
        if i < len(interval)-1:
            volumes.append(math.pi * radius**2 * seg.eval(interval[i+1]).distance(seg.eval(interval[i])))
            srf_area.append(math.pi * 2 * radius * seg.eval(interval[i+1]).distance(seg.eval(interval[i])))
    return sum(srf_area)/sum(volumes)

a.put(area_to_volume_ratio)
# ---------- end decodes_4 ----------
make_surf_function = Data(decodes.a)
make_surf_function_2 = Data(decodes_2.a)
fitness_function = Data(decodes_4.a)
make_mesh_function = Data(decodes_3.a)
cluster = Cluster(num=slider_2, V=md_slider, num_2=slider)  # disabled
slider_3 = Slider(1, range=1..20)
slider_4 = Slider(10, range=0..10)
pi = Pi(Factor=Slider(1, range=0..10))
decodes_5 = DecodesPythonScript(make_msh=make_mesh_function, make_surf=make_surf_function_2, fitness=fitness_function, res=slider_3, thresh=slider_4)  # -> console, a, a_props, b, b_props, c, c_props; inputs res: Int32
# ---------- decodes_5: Python ----------
best_fit = thresh
for ri in Interval().divide(res,include_last=True):
    for gi in Interval().divide(res,include_last=True):
        if gi == 0: gi = 0.001
        for bi in Interval().divide(res,include_last=True):
            surf = make_surf(ri,gi,bi)
            fit = fitness(surf)
            clr = Color(ri,gi,bi)
            msh = make_msh(surf)
            # Now define the move vector for each....
            xf = Xform.translation(Vec()-Vec(ri*2,gi*2,bi*2))
            move_msh = msh *xf 
            move_msh.set_color(clr)
            if fit <= best_fit:
                best_fit = fit
                best_msh = move_msh
            if fit < thresh : 
                a.put(move_msh)
b.put(best_msh)
c.put(best_fit)
# ---------- end decodes_5 ----------
dom = Domain(DomainStart=Slider(0, range=0..6.28), DomainEnd=pi)
pts = Point(cluster)
decodes_6 = DecodesPythonScript(make_surf=make_surf_function_2, fitness=fitness_function, res=slider_3, thresh=slider_4)  # -> console, a, a_props, b, b_props, c, c_props; inputs res: Int32; disabled
# ---------- decodes_6: Python ----------
def make_msh(rr,gg,bb):
    surf = make_surf(rr,gg,bb)

    msh = Mesh()
    u_vals = Interval().divide(include_last=True)
    for ui in Interval().divide(include_last=True):
        for vi in u_vals:
            msh.append(surf(ui,vi).origin)
    
    res_u = len(u_vals)
    # simple triangulation style
    for v in range(len(u_vals)):
        row = v*res_u
        for u in range(len(u_vals)-1):
            pi_0 = row+u
            pi_1 = row+u+1
            pi_2 = row+u+res_u+1
            pi_3 = row+u+res_u
            msh.add_face(pi_0,pi_1,pi_2,pi_3)
            msh.set_color(Color(rr,gg,bb))
    fit = fitness(surf)
    return fitness(surf), msh

best_fit = 10
for bi in Interval().divide(res,include_last=True):
    gi = bi
    if bi == 0:
        gi = 0.001
    make_mshs = make_msh(bi/res,gi,bi/res)
    msh = make_mshs[1]
    fit = make_mshs[0]
    if fit < best_fit:
        best_fit = fit
        best_msh = msh
    if fit < thresh : a.put(msh)
b.put(best_msh)
c.put(best_fit)
"""
for ri in range(res+1):
    for gi in range(res+1):
        for bi in range(res+1):"""
# ---------- end decodes_6 ----------
decodes_7 = DecodesPythonScript(pts=pts, rot_ival=dom)  # -> console, a; inputs pts: list
# ---------- decodes_7: Python ----------
import math

def func(u,v):
    flat_pts = [Point(p.x,0,p.z) for p in pts]# ensure points lie on same plane as rotational axis by setting y=0
    
    angle = rot_ival.eval(u)
    xf = Xform.rotation(axis=Vec(0,0,1),angle=angle)
    rot_pts = [pt*xf for pt in flat_pts]
    
    crv = Curve.bezier(rot_pts)
    
    return crv.eval(v)
    

a.put(func)
# ---------- end decodes_7 ----------
hardboil = DecodesHardBoil(Geometry=decodes_5.a, Properties=decodes_5.a_props)
surface_function = Data(decodes_7.a)
panel = Panel(decodes_6.c)  # disabled
geo = Geometry(decodes_6.b)  # disabled
hardboil_2 = DecodesHardBoil(Geometry=decodes_6.a, Properties=decodes_6.a_props)  # disabled

# ==== cluster Cluster
V = ClusterInput()
num = ClusterInput()
num_2 = ClusterInput()
vcomp = Decompose(Vector=V)  # -> XComponent, YComponent, ZComponent
num_3 = Number(num)
num_4 = Number(num_2)
pt = PointXYZ(XComponent=vcomp.XComponent, YComponent=vcomp.ZComponent, ZComponent=vcomp.YComponent, System=PlaneXY(0, 0, 0))
pt_2 = PointXYZ(XComponent=num_4, YComponent=0, ZComponent=0, System=PlaneXY(0, 0, 0))
pt_3 = PointXYZ(XComponent=num_3, YComponent=0, ZComponent=1, System=PlaneXY(0, 0, 0))
pt_4 = Point([pt_2, pt, pt_3])
pt_5 = ClusterOutput(pt_4)
