# Grasshopper definition curve decomposition.ghx (Grasshopper 0.9.14)
# plug-ins: Decodes Python Interpreter

range = Range(Domain=Domain(0, 6.283185307), Steps=3)
range_2 = Range(Domain=Domain(0, 6.283185307), Steps=3)
# Decomposition of a Bezier curve into lines
slider = Slider(0.158, range=0.1..1)
sin = Sine(Value=range)
sin_2 = Sine(Value=range_2)
pt = Point([<point referenced from the Rhino model> x4])
geo = Geometry(<curve referenced from the Rhino model>)
pt_2 = PointXYZ(XComponent=range, YComponent=sin, ZComponent=0, System=PlaneXY(0, 0, 0))
pt_3 = PointXYZ(XComponent=range_2, YComponent=sin_2, ZComponent=0, System=PlaneXY(0, 0, 0))
cp = ControlPoints(Curve=geo)  # -> Points, Weights, Knots
decodes = DecodesPythonScript(pts=pt, threshold=slider)  # -> console, a, b; inputs pts: list
# ---------- decodes: Python ----------
def furthestFromLeastSquaresLineTotal(pts_in):
    x_m = 0
    y_m = 0
    xsq_m = 0
    ysq_m = 0
    xy_m = 0
    
    for pt in pts_in :
        x_m = x_m + pt.x 
        y_m = y_m + pt.y
        xsq_m = xsq_m + pt.x*pt.x
        ysq_m = ysq_m + pt.y*pt.y
        xy_m = xy_m + pt.x*pt.y
    
    n = len(pts_in)
    x_m = x_m/n
    y_m = y_m/n
    xsq_m = xsq_m/n
    ysq_m = ysq_m/n
    xy_m = xy_m/n
    
    if (xy_m != x_m*y_m):
        B = 0.5*((ysq_m - y_m*y_m)-(xsq_m - x_m*x_m))/(x_m*y_m -xy_m)
        m = [-B + math.sqrt(B*B + 1), -B - math.sqrt(B*B + 1)]
        y_coeff = [y_m - m[0]*x_m, y_m - m[1]*x_m]
        p = [Point(0, y_coeff[0]), Point(0, y_coeff[1])]
        n0 = Vec(-m[0], 1).normalized()
        n1 = Vec(-m[1], 1).normalized()
        #test for the line that gives the least (not the most!) distance
        d0 = 0
        d1 = 0
        for pt in pts_in:
            d0 = d0 +  abs(Vec(pt - p[0]).dot(n0))
            d1 = d1 +  abs(Vec(pt - p[1]).dot(n1))
        if d0 < d1:
            p_ls  = p[0]
            n_ls = n0
        else:
            p_ls = p[1]
            n_ls = n1
    else:
        p_ls = Point(x_m, 0)
        n_ls = Vec(1,0)
        
    d_max = 0
    i_max = 0
    for i in range(n):
        d = abs(Vec(pts_in[i] - p_ls).dot(n_ls))
        if (d > d_max):
            d_max = d
            i_max = i
    #print d_max, p_ls, n_ls
    print [i_max, d_max]
    return [i_max, d_max]

      
def decomposeCurve(pts_in, i_left, indices):
    [i_star, dist] = furthestFromLeastSquaresLineTotal(pts_in)
    indices.append(i_left + i_star)
    if (dist > threshold):
        if (i_star != 0):
            decomposeCurve(pts_in[:i_star], i_left, indices)
        if (i_star != len(pts_in)-1):
            decomposeCurve(pts_in[i_star+1:], i_left+i_star+1, indices)


curve_in = Curve.bezier(pts)
a.put(curve_in)

pts_curve = []
n = 50
pts_curve = [curve_in.eval(i/n).origin for i in range(n+1)]

i_keep = []
decomposeCurve(pts_curve, 0, i_keep)
print len(i_keep)," indices to keep:", sorted(i_keep)
pts_keep = [curve_in.eval(i/n).origin for i in sorted(i_keep)]
b.put(PLine(pts_keep))
# ---------- end decodes ----------
decodes_2 = DecodesPythonScript(points=pt_2, threshold=Slider(0.05, range=0..0.2), step_size=Slider(0.1, range=0.05..0.5))  # -> console, a, b, c; inputs points: list
# ---------- decodes_2: Python ----------
"""
Decomposes a curve into a PLine
IN: List of Points to create a bezier curve
    Step size for the T values
    Distance threshold for the points
OUT: Curve
     [Point]
     PLine
"""
curve = Curve.bezier(points)
divs_t = [0.0]
delta_t = step_size
while divs_t[-1] <= curve.domain.b:
    t0 = divs_t[-1]
    t1 = t0 + delta_t
    if t1 >= curve.domain.b :
        divs_t.append(curve.domain.b)
        break
    subcrv = curve.subcurve(Interval(t0,t1))
    pt = Segment(curve.eval(t0),curve.eval(t1)).midpoint
    dist = pt.distance(subcrv.near_pt(pt).origin)
    if dist >= threshold:
        divs_t.append(t1)
        delta_t = step_size
    else:
        delta_t = delta_t + step_size

div_pts = [curve.eval(t).origin for t in divs_t]

a.put(curve)
b.put(PLine(div_pts))
c.put(div_pts)
# ---------- end decodes_2 ----------
decodes_3 = DecodesPythonScript(points=pt_3, threshold=Slider(0.05, range=0..0.2), step_size=Slider(0.1, range=0.05..0.5))  # -> console, a, b, c; inputs points: list; same code as decodes_2
panel = Panel(decodes.a)
