# Grasshopper definition great court roof.ghx (Grasshopper 0.9.14)
# plug-ins: Decodes Python Interpreter

rec_w = Slider(4.2, range=1..8)
rec_h = Slider(6.8, range=1..8)
rad = Slider(0.98, range=0.1..3)
height = Slider(0.4, range=-1..1.5)
panel = Panel("Circle")
decodes = DecodesPythonScript(rad=rad)  # -> console, a
# ---------- decodes: Python ----------
import math

def func(t):
    c = math.cos(t)
    s = math.sin(t)
    pt_out = Point(rad*c, rad*s)
    return pt_out
     

a.put(func)
# ---------- end decodes ----------
# Rectangular curve parametrized by even intervals along boundary
decodes_2 = DecodesPythonScript(rec_w=rec_w, rec_h=rec_h)  # -> console, a; disabled
# ---------- decodes_2: Python ----------
def func(t):
    if (t>=0) and (t<0.25): 
        ln = Line( Point(-rec_w/2,-rec_h/2), Point(rec_w/2,-rec_h/2) )
        pt_out = ln.eval(t*4.0)
    elif (t>=0.25) and (t<0.5): 
        ln = Line( Point(rec_w/2,-rec_h/2), Point(rec_w/2,rec_h/2) )
        pt_out = ln.eval((t-0.25)*4.0)
    elif (t>=0.5) and (t<0.75): 
        ln = Line( Point(rec_w/2,rec_h/2), Point(-rec_w/2,rec_h/2) )
        pt_out = ln.eval((t-0.5)*4.0)
    elif (t>=0.75) and (t<=1.0): 
        ln = Line( Point(-rec_w/2,rec_h/2), Point(-rec_w/2,-rec_h/2) )
        pt_out = ln.eval((t-0.75)*4.0)
    else: print "wtf?"
      
    return pt_out
    

#a.put(func)


crv = Curve(func,Interval(0,1))
a.put(crv)
# ---------- end decodes_2 ----------
decodes_3 = DecodesPythonScript(rec_w=rec_w, rec_h=rec_h, rad=rad)  # -> console, a, domain
# ---------- decodes_3: Python ----------
import math


def func1(t):
    c = math.cos(t)
    s = math.sin(t)
    pt_out = Point(rad*c, rad*s)
    return pt_out
     
def func2(t):
    c = math.cos(t)
    s = math.sin(t)
    alpha = math.atan(rec_h/rec_w)
    pi = math.pi
    pi_over_2 = 0.5*pi
    
    if (t >=0) and (t < alpha):
        l_coord = 0.5*rec_w*s/c
        pt_out = Point(rec_w/2, l_coord)
    elif (t >= alpha) and (t < pi-alpha):
        l_coord = 0.5*rec_h*c/s
        pt_out = Point(l_coord, rec_h/2)
    elif (t >= pi-alpha) and (t < pi + alpha):
        l_coord = -0.5*rec_w*s/c
        pt_out = Point(-rec_w/2, l_coord)
    elif (t >= pi + alpha) and (t < 2*pi - alpha):
        l_coord = -0.5*rec_h*c/s
        pt_out = Point(l_coord, -rec_h/2) 
    elif (t >= 2*pi-alpha) and (t <= 2*pi):
        l_coord = 0.5*rec_w*s/c
        pt_out = Point(rec_w/2, l_coord)
    else:
        print "Out-of-bounds!"
   
    return pt_out
    
def func(u,v):
    return func1(u)*(1-v) + func2(u)*v
      

a.put(func)

domain.put([0,2*math.pi, 0, 1])
# ---------- end decodes_3 ----------
# Rectangle parametrized in polar coordinates
decodes_4 = DecodesPythonScript(rec_w=rec_w, rec_h=rec_h)  # -> console, a
# ---------- decodes_4: Python ----------
import math


def func(t):
    c = math.cos(t)
    s = math.sin(t)
    alpha = math.atan(rec_h/rec_w)
    pi = math.pi
    pi_over_2 = 0.5*pi
    
    if (t >=0) and (t < alpha):
        l_coord = 0.5*rec_w*s/c
        pt_out = Point(rec_w/2, l_coord)
    elif (t >= alpha) and (t < pi-alpha):
        l_coord = 0.5*rec_h*c/s
        pt_out = Point(l_coord, rec_h/2)
    elif (t >= pi-alpha) and (t < pi + alpha):
        l_coord = -0.5*rec_w*s/c
        pt_out = Point(-rec_w/2, l_coord)
    elif (t >= pi + alpha) and (t < 2*pi - alpha):
        l_coord = -0.5*rec_h*c/s
        pt_out = Point(l_coord, -rec_h/2) 
    elif (t >= 2*pi-alpha) and (t <= 2*pi):
        l_coord = 0.5*rec_w*s/c
        pt_out = Point(rec_w/2, l_coord)
    else:
        print "Out-of-bounds!"
   
    return pt_out
     


#crv = Curve(func,Interval(0,2*math.pi), 0.01)
a.put(func)
# ---------- end decodes_4 ----------
decodes_5 = DecodesPythonScript(rec_w=rec_w, rec_h=rec_h, rad=rad, height=height)  # -> console, a
# ---------- decodes_5: Python ----------
import math


def func(u,v):
    
    theta = (math.pi*2*u) - (math.pi/2) - math.atan(rec_w/rec_h)
    spt = Point(rad*math.cos(theta), rad*math.sin(theta) )
    if (u>=0) and (u<0.25): 
        ln = Line( Point(-rec_w/2,-rec_h/2), Point(rec_w/2,-rec_h/2) )
        ept = ln.eval(u*4.0)
    elif (u>=0.25) and (u<0.5): 
        ln = Line( Point(rec_w/2,-rec_h/2), Point(rec_w/2,rec_h/2) )
        ept = ln.eval((u-0.25)*4.0)
    elif (u>=0.5) and (u<0.75): 
        ln = Line( Point(rec_w/2,rec_h/2), Point(-rec_w/2,rec_h/2) )
        ept = ln.eval((u-0.5)*4.0)
    elif (u>=0.75) and (u<=1.0): 
        ln = Line( Point(-rec_w/2,rec_h/2), Point(-rec_w/2,-rec_h/2) )
        ept = ln.eval((u-0.75)*4.0)
    else: print "wtf?"
        
    ln = Segment(spt,ept)
    pt = ln.eval(v)
    pt.z = math.sin(v*math.pi)*height
    return pt
    

a.put(func)
# ---------- end decodes_5 ----------
# Tweening for functions parametrized with the interval [0, 2pi]
slider = Slider(1, range=0..1)
res_v = Slider(80, range=2..80)
res_u = Slider(17, range=4..50)
decodes_6 = DecodesPythonScript(m=slider, func1=decodes.a, func2=decodes_4.a)  # -> console, a
# ---------- decodes_6: Python ----------
#Interpolates between two curves given by func1 and func2, both defined on [0,2pi]
import math

def func(t):
    return func1(t)*(1-m) + func2(t)*m
      
crv_out = Curve(func,Interval(0,2*math.pi), 0.01)
a.put(crv_out)
# ---------- end decodes_6 ----------
# Surface parametrized in [0,2pi] expressed as a triangulated mesh
decodes_7 = DecodesPythonScript(func=decodes_3.a, domain=decodes_3.domain, res_u=res_v, res_v=res_u)  # -> console, a; inputs domain: list
# ---------- decodes_7: Python ----------
#IN:   a function f(u,v) describing a parametric surface on the domain [0,2*pi]x[0,1]
#OUT:  Surface expressed as a mesh, simple triangulation style

u0 = domain[0]
u1 = domain[1]
v0 = domain[2]
v1 = domain[3]

count_u = int(res_u)
count_v = int(res_v)
tol_u = (u1-u0)/res_u
tol_v = (v1-v0)/res_v
u_vals = [u0 + i*tol_u for i in range(count_u+1)]
v_vals = [v0 + i*tol_v for i in range(count_v+1)]


msh = Mesh()
for v in v_vals:
    for u in u_vals:
        msh.append(func(u,v))

for j in range(count_v):
    row = j*(count_u+1)
    for i in range(count_u):
        pi_0 = row+i
        pi_1 = row+i+1
        pi_2 = row+i+count_u+2
        pi_3 = row+i+count_u+1
        msh.add_face(pi_0,pi_1,pi_2)
        msh.add_face(pi_0, pi_2, pi_3)

a.put(msh)
# ---------- end decodes_7 ----------
# Surface parametrized in [0,2pi] expressed as a quad mesh aligned with isocurves
decodes_8 = DecodesPythonScript(domain=decodes_3.domain, res_u=res_v, res_v=res_u)  # -> console, a; inputs domain: list
# ---------- decodes_8: Python ----------
#IN:   a function f(u,v) describing a parametric surface on the domain [0, 2pi]x[0,1]
#OUT:  Surface expressed as a mesh aligned with isocurves for u, v determined by res_u and res_v 

import math

u0 = domain[0]
u1 = domain[1]
v0 = domain[2]
v1 = domain[3]

count_u = int(res_u)
count_v = int(res_v)
tol_u = (u1-u0)/res_u
tol_v = (v1-v0)/res_v
u_vals = [u0 + i*tol_u for i in range(count_u+1)]
v_vals = [v0 + i*tol_v for i in range(count_v+1)]

#Expressed as a mesh with faces determined by isocurves
msh = Mesh()
for v in v_vals:
    for u in u_vals:
        msh.append(func(u,v))

for j in range(count_v):
    row = j*(count_u+1)
    for i in range(count_u):
        pi_0 = row+i
        pi_1 = row+i+1
        pi_2 = row+i+count_u+2
        pi_3 = row+i+count_u+1
        msh.add_face(pi_0,pi_1,pi_2,pi_3)

a.put(msh)
# ---------- end decodes_8 ----------
res_u_2 = Slider(17, range=4..30)  # disabled
res_v_2 = Slider(4, range=2..10)  # disabled

# ---- group: simple triangulated mesh
decodes_9 = DecodesPythonScript(res_u=res_u_2, res_v=res_v_2)  # -> console, a; inputs res_u: Int32, res_v: Int32; disabled
# ---------- decodes_9: Python ----------
# convert res_u to nearest multiple of 4.0
if res_u%4 != 0 : 
    res_u = res_u + (4 - res_u%4)
    print "res_u set to ", res_u

msh = Mesh()
for v in range(res_v+1):
    for u in range(res_u):
        msh.append(func(u/res_u,v/res_v))

# simple triangulation style
for v in range(res_v):
    row = v*res_u
    for u in range(res_u-1):
        pi_0 = row+u
        pi_1 = row+u+1
        pi_2 = row+u+res_u
        pi_3 = row+u+res_u+1
        msh.add_face(pi_0,pi_1,pi_2)
        msh.add_face(pi_1,pi_3,pi_2)
    #last two faces in the row
    pi_0 = row+res_u-1
    pi_1 = row+0
    pi_2 = row+res_u-1+res_u
    pi_3 = row+res_u
    msh.add_face(pi_0,pi_1,pi_2)
    msh.add_face(pi_1,pi_3,pi_2)

a.put(msh)
# ---------- end decodes_9 ----------

# ---- group: centroid triangulated mesh
decodes_10 = DecodesPythonScript(res_u=res_u_2, res_v=res_v_2)  # -> console, a; inputs res_u: Int32, res_v: Int32; disabled
# ---------- decodes_10: Python ----------
# convert res_u to nearest multiple of 4.0
if res_u%4 != 0 : 
    res_u = res_u + (4 - res_u%4)
    print "res_u set to ", res_u

msh = Mesh()
for v in range(res_v+1):
    for u in range(res_u):
        msh.append(func(u/res_u,v/res_v))

# centroid triangulation style
for v in range(res_v):
    row = v*res_u
    for u in range(res_u-1):
        pi = [row+u,row+u+1,row+u+res_u,row+u+res_u+1]
        msh.append(Point.centroid([msh.pts[i] for i in pi])) # add one more vertex at the center
        pi.append(len(msh.pts)-1)
        msh.add_face(pi[0],pi[1],pi[4])
        msh.add_face(pi[1],pi[3],pi[4])
        msh.add_face(pi[3],pi[2],pi[4])
        msh.add_face(pi[2],pi[0],pi[4])
    #last two faces in the row
    pi = [ row+res_u-1, row+0, row+res_u-1+res_u, row+res_u ]
    msh.append(Point.centroid([msh.pts[i] for i in pi])) # add one more vertex at the center
    pi.append(len(msh.pts)-1)
    msh.add_face(pi[0],pi[1],pi[4])
    msh.add_face(pi[1],pi[3],pi[4])
    msh.add_face(pi[3],pi[2],pi[4])
    msh.add_face(pi[2],pi[0],pi[4])

a.put(msh)
# ---------- end decodes_10 ----------

# ----
gcr_mesh_simple_tri = Mesh(decodes_9.a)  # disabled
gcr_mesh_centroid_tri = Mesh(decodes_10.a)  # disabled
