# Grasshopper definition torus circles.ghx (Grasshopper 0.9.14)
# plug-ins: Decodes Python Interpreter

r = Slider(2, range=2..5)
R = Slider(5, range=5..10)
decodes = DecodesPythonScript(r=r, R=R)  # -> console, a, b
# ---------- decodes: Python ----------
"""
Torus 
    x = (R + r*math.cos(v))*math.cos(u)
    y = (R + r*math.cos(v))*math.sin(u)
    z = r*math.sin(v)
    domain = [0, 2*pi]x[0, 2*pi]
"""

import math



def torus_1(u,v):
    u_val = 2*math.pi*u
    v_val = 2*math.pi*v
    rho = R + r*math.cos(v_val)
    pt_out = Point(rho*math.cos(u_val), rho*math.sin(u_val), r*math.sin(v_val))
    return pt_out


#Alternate parametrization that gives isocurves along the Villarceau circles
#[FIX - need to do change of coords]
#v = 'phi'
#u = 'theta'
def torus_2(u,v):
    tilt = r/R
    alpha = math.asin(tilt)
    u_val = 2*math.pi*u
    v_val = 2*math.pi*v
    gamma = v_val
    
    rho = R+math.cos(v_val)*r
    x_ref = rho*math.cos(u_val)
    y_ref = rho*math.sin(u_val)
    z_ref = r*math.cos(v_val)
    
    x_2 = x_ref
    y_2 = y_ref
    z_2 = z_ref
    
    x_1 = r + R*math.cos(gamma)
    y_1 = R*math.sin(gamma)*math.cos(alpha)
    z_1 = r*math.sin(gamma)
    
    psi = math.atan2(x_1*y_2 - x_2*y_1, x_1*x_2 + y_1*y_2)
      
    x_2 = x_1*math.cos(psi) - y_1*math.sin(psi)
    y_2 = x_1*math.sin(psi) + y_1*math.cos(psi)
    z_2 = z_1
    
    pt_out = Point(x_2, y_2, z_2)
    return pt_out
 
 
a.put(torus_1)

b.put(torus_2)
# ---------- end decodes ----------
decodes_2 = DecodesPythonScript(r=r, R=R)  # -> console, a
# ---------- decodes_2: Python ----------
import math

def func(t):
    t_value = 2*math.pi*t
    c = math.cos(t_value)
    s = math.sin(t_value)
    pt_out = Point(r + R*c, math.sqrt(R*R-r*r)*s, r*s)
    return pt_out
     

a.put(func)

print func(1)
# ---------- end decodes_2 ----------
res_v = Slider(18, range=2..20)
res_u = Slider(23, range=4..50)
decodes_3 = DecodesPythonScript(func_in=decodes_2.a)  # -> console, a
# ---------- decodes_3: Python ----------
#Draws one Villarceau curve passing through (r,0,0)
#Can rotate to get the other other circle

crv_out = Curve(func_in,Interval(0,1))
a.put(crv_out)
# ---------- end decodes_3 ----------
decodes_4 = DecodesPythonScript(func=decodes.a, res_u=res_v, res_v=res_u)  # -> console, a
# ---------- decodes_4: Python ----------
#IN:   a function f(u,v) describing a parametric surface on the domain [0,1]x[0,1]
#OUT:  Surface expressed as a mesh aligned with isocurves for u, v determined by res_u and res_v 


count_u = int(res_u)
count_v = int(res_v)
tol_u = 1.0/res_u
tol_v = 1.0/res_v
u_vals = [i*tol_u for i in range(count_u+1)]
v_vals = [i*tol_v for i in range(count_v+1)]

#Expressed as a mesh with faces determined by isocurves
msh = Mesh()
for v in v_vals:
    for u in u_vals:
        msh.append(func(u,v))

for j in range(count_v):
    row = j*(count_u+1)
    for i in range(count_u):
        pi_0 = row+i
        pi_1 = row+i+1
        pi_2 = row+i+count_u+2
        pi_3 = row+i+count_u+1
        msh.add_face(pi_0,pi_1,pi_2,pi_3)

a.put(msh)
# ---------- end decodes_4 ----------
