# Grasshopper definition bezier_curves.ghx (Grasshopper 0.9.14)
# plug-ins: Decodes Python Interpreter

md_slider = MDSlider(
    slider_value=Point(0.7319999933, 0.3680000305, 0.5),
    x_domain=Domain(-0.5, 1.5),
    y_domain=Domain(-0.5, 1.5),
    z_domain=Domain(0, 1),
    SliderMode=0)
slider = Slider(0.0875, range=0..1)
pt = Point(Point(0, 0, 0))
pt_2 = Point(md_slider)
pt_3 = Point(Point(1, 1, 0))
pts = Point([Point(-0.9610811336, -2.074298095, 0), Point(-0.2385807026, -1.387942156, 0), Point(0.5472529461, -1.908522516, 0), Point(1.350597514, -1.351687855, 0), Point(2.074259354, -2.122590892, 0)])
decodes = DecodesPythonScript(pa=pt, pb=pt_2, pc=pt_3, t=slider)  # -> console, a, b
# ---------- decodes: Python ----------
crv = Curve.bezier([pa,pb,pc])
a.put(crv)
b.put(crv.eval(t))
# ---------- end decodes ----------
decodes_2 = DecodesPythonScript(pts=pts, t=slider)  # -> console, a, b; inputs pts: list
# ---------- decodes_2: Python ----------
crv = Curve.bezier(pts)
a.put(crv)
b.put(crv.eval(t))
# ---------- end decodes_2 ----------
crv = Curve([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])
pt_4 = Point(decodes.b)
pt_5 = Point(decodes_2.b)
