# Grasshopper definition circle_test.gh (Grasshopper 0.9.14)
# plug-ins: Decodes Python Interpreter

decodes = DecodesPythonScript(x=Slider(0.6, range=0..1))  # -> console, a
# ---------- decodes: Python ----------
circ = Circle(Plane(Point(),Vec(x,1,0)),10)
a.put(circ)
# ---------- end decodes ----------
circle = Circle(decodes.a)
decodes_2 = DecodesPythonScript(circ=circle)  # -> console, a
# ---------- decodes_2: Python ----------
print circ
print circ.plane, circ.rad
# ---------- end decodes_2 ----------
panel = Panel(decodes_2.console)
