# Grasshopper definition classical_surfaces.gh (Grasshopper 0.9.14)
# plug-ins: Decodes Python Interpreter

md_slider = MDSlider(
    slider_value=Point(0.4287801603, 0.4619047982, 0.5),
    x_domain=Domain(-1, 1),
    y_domain=Domain(-5, -1),
    z_domain=Domain(0, 1),
    SliderMode=0)
md_slider_2 = MDSlider(
    slider_value=Point(0.6256098864, 0.6816664196, 0.5),
    x_domain=Domain(0, 1),
    y_domain=Domain(0, 1),
    z_domain=Domain(0, 1),
    SliderMode=0)
vec = Vector(md_slider)

# ---- group: Translational
decodes = DecodesPythonScript(vec=vec, uv=md_slider_2)  # -> console, a, b
# ---------- decodes: Python ----------
from decodes.extensions.classical_surfaces import *

def func(t):
    return Point(t,0,math.sin(t)+1.5)
crv = Curve(func,Interval(0,math.pi*2))
surf = TranslationalSurface(crv,vec)


u,v = surf.domain_u.eval(uv.x), surf.domain_v.eval(uv.y)

a.put(surf.surrogate)
b.put(surf.deval_pln(u,v))
b.put(surf.deval(u,v))
# ---------- end decodes ----------

# ---- group: Rotational
decodes_2 = DecodesPythonScript(vec=vec, uv=md_slider_2)  # -> console, a, b, c
# ---------- decodes_2: Python ----------
from decodes.extensions.classical_surfaces import *

def func(t):
    return Point(t,math.sin(t)+1.5)
crv = Curve(func,Interval(0,math.pi*2))
surf = RotationalSurface(crv,vec)

u,v = surf.domain_u.eval(uv.x), surf.domain_v.eval(uv.y)

a.put(surf.surrogate)
b.put(surf.deval_pln(u,v))
b.put(surf.deval(u,v))

iso_v = surf.isocurve(v_val=v)
iso_u = surf.isocurve(u_val=u)
c.put([iso_u,iso_v.surrogate])
# ---------- end decodes_2 ----------

# ----
crv = Curve(decodes_2.c)
