# Grasshopper definition curvature_lines.gh (Grasshopper 0.9.14)
# plug-ins: Decodes Python Interpreter

md_slider = MDSlider(
    slider_value=Point(0.07463413332, 0.8739512374, 0.5),
    x_domain=Domain(0, 1),
    y_domain=Domain(0, 1),
    z_domain=Domain(0, 1),
    SliderMode=0)
_0_75_0_5 = Point(Point(0.5, 0.75, 0))
_0_5_0_5 = Point(Point(0.5, 0.5, 0))
decodes = DecodesPythonScript()  # -> console, a, b
# ---------- decodes: Python ----------
def func(u,v):
    return Point(u,v,math.sin(u*v))
    return Point(u,v,(u**3-3*u*v**2)/4)
    
ival = Interval(-1,1)
surf = Surface(func,ival,ival)
a.put(surf)
b.put(surf.surrogate)
# ---------- end decodes ----------
decodes_2 = DecodesPythonScript(res=Slider(5, range=3..7))  # -> console, a; inputs res: Int32
# ---------- decodes_2: Python ----------
for x in Interval(0.1,0.9).divide(res,True):
    for y in Interval(0.1,0.9).divide(res,True):
        a.put(Point(x,y))
# ---------- end decodes_2 ----------

# ---- group: testing
decodes_3 = DecodesPythonScript(surf=decodes.a, uv=md_slider)  # -> console, a, b, c; disabled
# ---------- decodes_3: Python ----------
u,v = uv.x,uv.y
ival_step = Interval(0.01,0.2)

crv = surf.eval_curv(u,v,True)
step_size = Interval.remap( abs(crv[1] - crv[2]) , Interval(0,2) , ival_step)
crv_cs = crv[0]
a.put(crv_cs)

pt, u_vec, v_vec = surf._nudged(surf.domain_u.eval(u),surf.domain_v.eval(v),False)
u_vec = u_vec.normalized()
v_vec = v_vec.normalized()
n_vec = u_vec.cross(v_vec)
crv_vec = crv_cs.x_axis.normalized()
#crv_vec = crv.x_axis.inverted().normalized() # to switch direction of curv lines
#crv_vec = crv.y_axis.inverted().normalized()

xsec = Intersector()
pln = Plane(pt+crv_vec,v_vec.cross(n_vec))
if xsec.of(pln,u_vec.to_line(pt)):
    #c.put(xsec[0])
    du = xsec.dist
else: print "no intersection", xsec.log
pln = Plane(pt+crv_vec,u_vec.cross(n_vec))
if xsec.of(pln,v_vec.to_line(pt)):
    #c.put(xsec[0])
    dv = xsec.dist
    
else: print "no intersection", xsec.log


d_vec = Vec(du,dv).normalized(step_size)
#print du,dv,d_vec
uv = uv+d_vec
u,v = uv.x,uv.y
b.put(surf.eval(u,v))

a.put([pt,u_vec.to_ray(pt),v_vec.to_ray(pt),n_vec.to_ray(pt),crv_vec.to_ray(pt)])
#pln = surf.deval_pln(u,v)
# ---------- end decodes_3 ----------

# ----
decodes_4 = DecodesPythonScript(surf=decodes.a, uv=md_slider, too_equal=Slider(0.0004, range=-0.0001..0.01))  # -> console, a, b, c
# ---------- decodes_4: Python ----------
ival_step = Interval(0.01,0.2)
max_unequal = 2.0
target_pt = surf.eval(0.5,0.5) # used to set which direction of the pline to walk first

def to_domain_vec(u,v,surf,real_vec):
    pt, u_vec, v_vec = surf._nudged(surf.domain_u.eval(u),surf.domain_v.eval(v),False)
    u_vec = u_vec.normalized()
    v_vec = v_vec.normalized()
    n_vec = u_vec.cross(v_vec)
    
    xsec = Intersector()
    pln = Plane(pt+real_vec,v_vec.cross(n_vec))
    if xsec.of(pln,u_vec.to_line(pt)):
        #c.put(xsec[0])
        du = xsec.dist
    else: print "no intersection", xsec.log
    pln = Plane(pt+real_vec,u_vec.cross(n_vec))
    if xsec.of(pln,v_vec.to_line(pt)):
        #c.put(xsec[0])
        dv = xsec.dist
    else: print "no intersection", xsec.log
    
    return Vec(du,dv)

def walk_curvature(uv_pt,direction="max_curv",do_flip=False):
    pts = [surf.eval(uv_pt.x,uv_pt.y)]
    at_edge = False
    step_vec = Vec(pts[0],target_pt)
    if do_flip : step_vec = step_vec.inverted()
    for n in range(50):
        crv = surf.eval_curv(uv_pt.x,uv_pt.y,True)
        equalness = abs(crv[1] - crv[2])
        if equalness < too_equal : at_edge = True
        step_size = Interval.remap( equalness , Interval(too_equal,max_unequal) , ival_step, True)
        if not crv[0] : break
        crv_cs = crv[0]
        if direction == "max_curv" : crv_vec = crv_cs.x_axis.normalized()
        if direction == "min_curv" : crv_vec = crv_cs.y_axis.normalized()
        
        d_vec = to_domain_vec(uv_pt.x,uv_pt.y,surf,crv_vec).normalized(step_size)
        if step_vec:
            if step_vec.angle(d_vec) > math.pi/2 : d_vec = d_vec.inverted()
        step_vec = d_vec
        
        uv_pt = uv_pt+step_vec
        if not uv_pt in Bounds.unit_square():
            uv_pt = Bounds.unit_square().near_pt(uv_pt)
            at_edge = True
            
        pts.append(surf.eval(uv_pt.x,uv_pt.y))
        if at_edge: break
    return pts
    
c.put(surf.eval(uv.x,uv.y))

pts = walk_curvature(uv,"max_curv",False)
pts.reverse()
pts.extend(walk_curvature(uv,"max_curv",True))
a.put(PLine(pts))

pts = walk_curvature(uv,"min_curv",False)
pts.reverse()
pts.extend(walk_curvature(uv,"min_curv",True))
b.put(PLine(pts))
# ---------- end decodes_4 ----------

slider = Slider(14, range=0..35)
crv = Curve([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])
pt = Point([Point(-0.8, -0.8, 0.5971954414), Point(-0.8, -0.48, 0.3746321507), Point(-0.8, -0.16, 0.1276507609), Point(-0.8, 0.16, -0.1276507609), Point(-0.8, 0.48, -0.3746321507), Point(-0.8, 0.8, -0.5971954414)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])
crv_2 = Curve([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])
item = ListItem(List=crv, Index=slider, Wrap=False)
item_2 = ListItem(List=crv_2, Index=slider, Wrap=False)
item_3 = ListItem(List=pt, Index=slider, Wrap=False)

# ---- group: direction vis
decodes_5 = DecodesPythonScript(surf=decodes.a)  # -> console, a, b, c
# ---------- decodes_5: Python ----------
u,v = uv.x,uv.y
step = 0.1


for u in surf.domain_u/11:
    for v in surf.domain_v/11:
        print u,v
        crv = surf.deval_curv(u,v,True)
        b.put(abs(crv[1] - crv[2]))
        if crv[0]: 
            crv_cs = crv[0]
            crv_vec = crv_cs.x_axis.normalized(0.1)
            #a.put(crv_cs)
            a.put(crv_vec.to_ray(crv_cs.origin))
# ---------- end decodes_5 ----------

# ----
panel = Panel(decodes_4.console)
data = Data([Point(-1, -1, 0.8414709848), Line((-1, -1, 0.8414709848), (-1.009708398, -0.9103623482, 0.7982177956)), Point(-1, -0.9333333333, 0.8036082637), Line((-1, -0.9333333333, 0.8036082637), (-0.9846746751, -0.8523957681, 0.7469139522)), Point(-1, -0.8666666667, 0.7621752729), Line((-1, -0.8666666667, 0.7621752729), (-0.9848564551, -0.7877863148, 0.7026054555))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])

data_2 = Data([Point(-1, -1, 2), Line((-1, -1, 2), (-1.099999757, -0.9998702506, 1.99982188)), Point(-1, -0.9333333333, 1.613333333), Line((-1, -0.9333333333, 1.613333333), (-0.9007017397, -0.9285116418, 1.624131796)), Point(-1, -0.8666666667, 1.253333333), Line((-1, -0.8666666667, 1.253333333), (-0.9017050074, -0.8554708312, 1.267919207))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])
data_3 = Data([Point(-1, -1, 0.5), Line((-1, -1, 0.5), (-1.09998895, -0.9991069016, 0.4988115754)), Point(-1, -0.9333333333, 0.4033333333), Line((-1, -0.9333333333, 0.4033333333), (-0.9030095657, -0.9427721498, 0.4257780297)), Point(-1, -0.8666666667, 0.3133333333), Line((-1, -0.8666666667, 0.3133333333), (-0.9041035268, -0.874062134, 0.340704367))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])
num = Number([7.24e-31, 0.0598463921, 0.07926681559, 0.1075295719, 0.1499567154, 0.215359686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])
num_2 = Number([2.41e-31, 0.4025932638, 0.4565097537, 0.5118186566, 0.5658445611, 0.6157111957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])

num_3 = Number([6.83e-30, 0.480176366, 0.4302814799, 0.384507163, 0.3424731677, 0.3037233687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])
sort = SortList(Keys=num_3)  # -> Keys, ValuesA
graph = QuickGraph(sort.Keys)
