# Grasshopper definition curve_test.gh (Grasshopper 0.9.14)
# plug-ins: Decodes Python Interpreter

decodes = DecodesPythonScript()  # -> console, a
# ---------- decodes: Python ----------
def func(t):
    return Point(t,math.sin(t))*10+Vec(100,100)

crv = Curve(func,Interval(0,math.pi*2))
a.put(crv)
# ---------- end decodes ----------
crv = Curve(decodes.a)
