# Grasshopper definition gh out test.gh (Grasshopper 0.9.14)
# plug-ins: Decodes Python Interpreter

slider = Slider(5, range=0..10)
decodes = PythonScript(x=slider)  # -> out, a, b, c
# ---------- decodes: Python ----------
## BEGIN HEAD ##
import decodes.core as dc
from decodes.core import *

inputs = ghenv.Component.Params.Input
outputs = ghenv.Component.Params.Output
for output in outputs :
    if output.NickName != "out":
        vars()[output.NickName] = dc.makeOut(outies.Grasshopper)

## END HEAD ##

pt = Point(1,1,x)
vec = Vec(0,10,x)
seg = Line(Point(1,1,x),Vec(0,0,-2))
cs = CS(Point(-2,-x), Vec(0,2,x))

verts = [
  Point(0.0       , 0.0	      , 0.0),
  Point(0.9510565 , 0.0	      , 0.0),
  Point(0.6881910 , 1.3763819 , 0.0),
  Point(0.5257311 , 0.6881910	, x/2)
]
faces = [[0,1,2],[0,2,3],[2,3,0],[3,0,1]]
mesh = dc.Mesh(verts,faces)

a.put(mesh)
a.put([[pt,pt,pt],[pt,pt,pt]])
a.put(vec)
a.put(10)

b.put(10)
b.put(20)

c.put("sdf")
c.put('d')


## BEGIN FOOT ##
for output in outputs :
    if output.NickName != "out":
        o = eval(output.NickName)
        if isinstance(o, dc.outies.GrasshopperOut) : vars()[output.NickName] = o.extract_tree()
        
## END FOOT ##
# ---------- end decodes ----------
decodes_2 = PythonScript(x=slider)  # -> out, a
# ---------- decodes_2: Python ----------
## BEGIN HEAD ##
import decodes.core as dc
from decodes.core import *

inputs = ghenv.Component.Params.Input
outputs = ghenv.Component.Params.Output
for output in outputs :
    if output.NickName != "out":
        vars()[output.NickName] = dc.makeOut(outies.Grasshopper)

## END HEAD ##
import decodes.extensions.danzerTile as dt

maxRecursion = 3
def recurse(tiles,rlvl=0):
  if rlvl < maxRecursion : return [recurse(tile.inflate(),rlvl+1) for tile in tiles]
  else : return [tile.draw() for tile in tiles]

a.put( recurse([dt.DzTileK()]) ) 

## BEGIN FOOT ##
for output in outputs :
    if output.NickName != "out":
        o = eval(output.NickName)
        if isinstance(o, dc.outies.GrasshopperOut) : vars()[output.NickName] = o.extract_tree()
        
## END FOOT ##
# ---------- end decodes_2 ----------
panel = Panel(decodes.a)
panel_2 = Panel(decodes_2.out)
panel_3 = Panel(decodes.out)
panel_4 = Panel(decodes.b)
panel_5 = Panel(decodes.c)
