# Grasshopper definition intersection test.ghx (Grasshopper 0.9.14)
# plug-ins: Decodes Python Interpreter

md_slider = MDSlider(
    slider_value=Point(0.1573171383, 0.2137196238, 0.5),
    x_domain=Domain(-1, 1),
    y_domain=Domain(-1, 1),
    z_domain=Domain(0, 1),
    SliderMode=0)
md_slider_2 = MDSlider(
    slider_value=Point(0.9814023739, 0.6231707385, 0.5),
    x_domain=Domain(-1, 1),
    y_domain=Domain(-1, 1),
    z_domain=Domain(0, 1),
    SliderMode=0)
vec = Vector(Vector(-1, 0, 0))
decodes = DecodesPythonScript(pt=md_slider_2, vec=md_slider)  # -> console, a, b
# ---------- decodes: Python ----------
pt = Point(0,pt.x,pt.y)
vec = Vec(0,vec.x,vec.y)
    
ray = Ray(pt,vec)
pln = CS().xz_plane

a.put(pln)
a.put(pln.normal.to_ray(pln.origin))
a.put(ray)

result = XSec()
if intersect(ray,pln,result,ignore_backface=True):
    # ray-plane intersections include the distance from the ray to the plane
    print "found intersection at distance",result.dist, " from ray origin"
    b.put(result[0])
else:
    print "no intersection"
# ---------- end decodes ----------
panel = Panel(decodes.console)
