# Grasshopper definition shelden packing.gh (Grasshopper 0.9.14)
# plug-ins: Decodes Python Interpreter

crv = Curve(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)
decodes = DecodesPythonScript(pgon=crv, mat_w=Slider(3.8, range=0.5..10), mat_h=Slider(0.5, range=0.1..1.1))  # -> console, a, b
# ---------- decodes: Python ----------
mat_size = mat_w, mat_h

#b.put([pgon.pts[0],pgon.pts[1],pgon.pts[2],pgon.pts[3]])

"""
edge = pgon.edges[0]
off_vec = edge.vec.cross(Vec(edge.spt,pgon.centroid)).cross(edge.vec)
line = Line(edge.spt + off_vec.normalized(mat_size[0]), edge.vec)

xsec = Intersector()

p0, p1 = None, None
if xsec.of(line,pgon.edges[-1]) : p0 = xsec[0]
if xsec.of(line,pgon.edges[1]) :p1 = xsec[0]
if p0 is None or p1 is None:
    print "wtf?"
#a.put(Segment(p0,p1))
"""

def panel_cut (fgon, mat_size, ee):
    edge = fgon.edges[ee]
    off_vec = edge.vec.cross(Vec(edge.spt,fgon.centroid)).cross(edge.vec)
    line = Line(edge.spt + off_vec.normalized(mat_size), edge.vec)
    
    xsec = Intersector()
    
    p0, p1 = None, None
    if xsec.of(line,fgon.edges[ee-1]) : p0 = xsec[0]
    if xsec.of(line,fgon.edges[ee-3]) :p1 = xsec[0]
    
    #div = Segment(p0,p1)
    panelpts = [p0,p1,fgon.pts[ee-3],fgon.pts[ee]]
    panel = PGon(panelpts)
    ngonspts =[p0,p1,fgon.pts[ee-2],fgon.pts[ee-1]]
    new_pgon = PGon(ngonspts)
    return [panel, new_pgon]

panels = panel_cut (pgon, mat_w, 3)


a.put(panels[0])
b.put(panels[1])
# ---------- end decodes ----------
geo = Geometry(decodes.a)
geo_2 = Geometry(decodes.b)
